# Grasshopper definition daylight_guided_furniture_layout.gh (Grasshopper 1.0.7)

# ----
# Room
# Input
floor = Curve(<curve referenced from the Rhino model>)
win = Curve([<curve referenced from the Rhino model> x2])
door_buffer = Curve(<curve referenced from the Rhino model>)

# ----
# Furniture
# Input
bed = Curve(<curve referenced from the Rhino model>)
lounge = Curve(<curve referenced from the Rhino model>)
desk = Curve(<curve referenced from the Rhino model>)

# ----
# Define Sides that snap on walls
explode = Explode(Curve=bed, Recursive=True)  # -> reparameterize(Segments), Vertices
explode_2 = Explode(Curve=lounge, Recursive=True)  # -> reparameterize(Segments), Vertices
explode_3 = Explode(Curve=desk, Recursive=True)  # -> reparameterize(Segments), Vertices
hframe = HorizontalFrame(Curve=explode.Segments, Parameter="0.5")
hframe_2 = HorizontalFrame(Curve=explode_2.Segments, Parameter="0.5")
hframe_3 = HorizontalFrame(Curve=explode_3.Segments, Parameter="0.5")
panel = Panel("""1
0""")
item = ListItem(List=hframe_3, Index="2", Wrap=True)
item_2 = ListItem(List=hframe_2, Index="3", Wrap=True)
cull_i = CullIndex(List=hframe, Indices=panel, Wrap=True)  # -> graft(List)

# ----
# Floor plan subdivision
explode_4 = Explode(Curve=floor, Recursive=True)  # -> Segments, Vertices
divlength = DivideLength(Curve=explode_4.Segments, Length="60")  # -> Points, Tangents, Parameters
hframe_4 = HorizontalFrame(Curve=graft(explode_4.Segments), Parameter=divlength.Parameters)  # -> flatten(Frame)

crv = Curve(<curve referenced from the Rhino model>)
pt = Point(<point referenced from the Rhino model>)
# (Need to implement Furniture Classes Transformation)
panel_2 = Panel("30")
python = GhPythonScript(Crv=crv, Pt=pt)  # -> Out, A
furniture_classes = GhPythonScript(i_bed=bed, i_bed_buffer=panel_2, i_lounge=lounge, i_lounge_buffer="30", i_desk=desk, i_desk_buffer="35")  # -> out, a, b, c; inputs i_bed: Curve, i_lounge: Curve, i_desk: Curve
# ---------- furniture_classes: Python ----------
import Rhino.RhinoDoc
import Rhino.Geometry as rh
import math
tol = Rhino.RhinoDoc.ActiveDoc.ModelAbsoluteTolerance

# functions
def get_vertices(curve):
    vertices = []
    segments = curve.DuplicateSegments()
    for seg in segments:
        vertices.append(seg.PointAtStart)
    return vertices

def shortest_length(curve):
    segments = curve.DuplicateSegments()
    shortest = segments[0].GetLength()
    for i in range(1, len(segments)):
        length = segments[i].GetLength()
        if  shortest > length:
            shortest = length
    return shortest
    
def get_middle(curve):
    return curve.PointAtLength(curve.GetLength() / 2)
    
def get_horizontal_frame(curve, t):
    plane_x = rh.Vector3d(curve.TangentAt(t).X, curve.TangentAt(t).Y, 0)
    plane_x.Unitize()
    plane_y = rh.Vector3d(curve.TangentAt(t).X, curve.TangentAt(t).Y, 0)
    plane_y.Rotate(math.pi * 0.5, rh.Vector3d.ZAxis)
    plane_y.Unitize()
    horizontal_frame = rh.Plane(curve.PointAt(t), plane_x, plane_y)
    return horizontal_frame
    

# furniture classes
class Bed:
    def __init__(self, body):
        self.body = body
        self.buffer = self.get_buffer()
        self.anchor = self.get_anchor()
    
    def get_buffer(self):
        buffer = []
        shortest = shortest_length(self.body)
        pts = get_vertices(self.body)
        buffer_pts = list(pts)
        n = len(pts)
        
        for i in range(n):
            vec = pts[i] - pts[(i+1) % n]
            if abs(vec.Length - shortest) < tol: # for short sides of rectangles
                vec.Unitize()
                translate = vec * i_bed_buffer
                if i == len(pts) - 1: # corner case: last pair of corners
                    curve = rh.NurbsCurve(buffer[0])
                    curve.Translate(translate)
                    buffer.append(curve)
                else:
                    buffer_pts[i] += translate
                    buffer_pts[i-1] += translate
                    buffer.append(rh.NurbsCurve.Create(True, 1, buffer_pts))
        return buffer
        
    # set the middle point of the left & top side as an anchor
    def get_anchor(self):
        segments = self.body.DuplicateSegments()
        seg_left = segments[0]
        seg_top = segments[0]
        
        for seg in segments:
            if get_middle(seg_left).X > get_middle(seg).X:
                seg_left = seg
            if get_middle(seg_top).Y < get_middle(seg).Y:
                seg_top = seg
        
        anchor = []
        anchor.append(get_horizontal_frame(seg_left, seg_left.Domain.Mid))
        anchor.append(get_horizontal_frame(seg_top, seg_top.Domain.Mid))
        return anchor

class Lounge:
    def __init__(self, body):
        self.body = body
        self.buffer = self.get_buffer()
        self.anchor = self.get_anchor()
        
    def get_buffer(self):
        buffer = []
        shortest = shortest_length(self.body)
        pts = get_vertices(self.body)
        buffer_pts = list(pts)
        n = len(pts)
        
        for i in range(n):
            vec = pts[i] - pts[(i+1) % n]
            if abs(vec.Length - shortest) < tol: # short sides
                vec.Unitize()
                translate = vec * i_lounge_buffer
                if i == len(pts)-1: # corner case: last pair of corners
                    curve = rh.NurbsCurve(buffer[0])
                    curve.Translate(translate)
                    buffer.append(curve)
                else:
                    buffer_pts[i] += translate
                    buffer_pts[i-1] += translate
                    buffer.append(rh.NurbsCurve.Create(True, 1, buffer_pts))
        return buffer
        
    # set the middle point of the left side as an anchor
    def get_anchor(self):
        segments = self.body.DuplicateSegments()
        seg_left = segments[0]
        
        for seg in segments:
            if get_middle(seg_left).X > get_middle(seg).X:
                seg_left = seg
        
        anchor = []
        anchor.append(get_horizontal_frame(seg_left, seg_left.Domain.Mid))
        return anchor
     
class Desk:
    def __init__(self, body):
        self.body = body
        self.buffer = self.get_buffer()
        self.anchor = self.get_anchor()
        
    def get_buffer(self):
        buffer = []
        shortest = shortest_length(self.body)
        pts = get_vertices(self.body)
        buffer_pts = list(pts)
        n = len(pts)
        
        for i in range(n):
            vec = pts[i] - pts[(i+1) % n]
            if abs(vec.Length - shortest) < tol: # short sides
                vec.Unitize()
                translate = vec * i_desk_buffer
                buffer_pts[i] += translate
                buffer_pts[i-1] += translate
                buffer.append(rh.NurbsCurve.Create(True, 1, buffer_pts))
                break
        return buffer
        
    # set the middle point of the left side as an anchor
    def get_anchor(self):
        segments = self.body.DuplicateSegments()
        seg_left = segments[0]
        
        for seg in segments:
            if get_middle(seg_left).X > get_middle(seg).X:
                seg_left = seg
        
        anchor = []
        anchor.append(get_horizontal_frame(seg_left, seg_left.Domain.Mid))
        return anchor
      
# outputs
bed = Bed(i_bed)
lounge = Lounge(i_lounge)
desk = Desk(i_desk)
a = bed.anchor
b = lounge.anchor
c = desk.anchor
# ---------- end furniture_classes ----------
panel_3 = Panel(furniture_classes.out)
geo = Geometry(furniture_classes.a)

# ----
# Iterate Furniture Combinations
# bed
# lounge
# desk
orient = Orient(Geometry=bed, Source=cull_i, Target=hframe_4)  # -> flatten(Geometry), Transform
orient_2 = Orient(Geometry=lounge, Source=item_2, Target=hframe_4)  # -> Geometry, Transform
orient_3 = Orient(Geometry=desk, Source=item, Target=hframe_4)  # -> Geometry, Transform
crossref = CrossReference(ListA=orient.Geometry, ListB=orient_2.Geometry, ListC=orient_3.Geometry, CrossMode=1)  # -> ListA, ListB, ListC
counts = Counts(L=orient.Geometry, L_2=orient_2.Geometry, L_3=orient_3.Geometry)
computing_space = Panel(counts)
merge = Merge(Data1=simplify(graft(crossref.ListA)), Data2=simplify(graft(crossref.ListB)), Data3=simplify(graft(crossref.ListC)))

# ----
# Define Evaluation logic
area = Area(Geometry=win)  # -> Area, Centroid
# Bed: Longer distance from window -> Higher score
# Lounge: Shorter distance from the window -> Higher score
# Desk: Shorter distance from the window -> Higher score
area_2 = Area()  # -> Area, Centroid
dist = Distance(PointA=area.Centroid, PointB=area_2.Centroid)
# Filter Collision Combinations
# (Need to implement Buffer Collision)
collision_detection = GhPythonScript(i_floor=floor, i_door=door_buffer, i_win=win, i_combinations=merge)  # -> out, o_combinations, o_count; inputs i_floor: Curve, i_door: Curve, i_win: list of Curve, i_combinations: tree of Curve
# ---------- collision_detection: Python ----------
import Rhino.RhinoDoc
import Rhino.Geometry as rh
tol = Rhino.RhinoDoc.ActiveDoc.ModelAbsoluteTolerance

# functions
def get_vertices(curves):
    vertices = []
    for curve in curves:
        segments = curve.DuplicateSegments()
        for seg in segments:
            vertices.append(seg.PointAtStart)
    return vertices
    
def get_vertices_middle(curves):
    vertices = []
    for curve in curves:
        segments = curve.DuplicateSegments()
        for seg in segments:
            len = seg.GetLength()
            mid = seg.PointAtLength(len / 2)
            vertices.append(seg.PointAtStart)
            vertices.append(mid)
    return vertices


# Collision Detection:
# pointContainment(unset = 0, inside = 1, outside = 2, coincident = 3)
combinations_filter = []
for i in range(i_combinations.BranchCount):
    rects = i_combinations.Branch(i)
    pts = get_vertices(rects)
    
    # Wall Collision: check if furniture vertices outside floor plan
    wall_collision = False
    for pt in pts:
        containment = int(i_floor.Contains(pt, rh.Plane.WorldXY, tol))
        if containment == 2: 
            wall_collision = True
            break
    if wall_collision:
        continue
    
    # Furniture Collision: check if furnitures collide each other
    furniture_collision = False
    obstacles = [] # add i_door to obstacles list
    for rect in rects:
        obstacles.append(rect)
    obstacles.append(i_door)
    pts_with_mid = get_vertices_middle(obstacles)
    for obstacle in obstacles:
        for pt in pts_with_mid:
            containment = int(obstacle.Contains(pt, rh.Plane.WorldXY, tol))
            if containment == 1:
                furniture_collision = True
                break
    if furniture_collision:
        continue

    # Furniture Combinations with no Collisions
    combinations_filter.append(rects)


# ouputs
o_combinations = combinations_filter
o_count = len(combinations_filter)
# ---------- end collision_detection ----------
bang = ExplodeTree(Data=dist)  # -> Branch0, Branch1, Branch2
num_bed = Number(bang.Branch0)
num_lounge = Number(bang.Branch1)
num_desk = Number(bang.Branch2)
o_count = Panel(collision_detection.o_count)
visualize = GhPythonScript(i_combinations=collision_detection.o_combinations, index=Slider(188, range=0..300))  # -> out, o_combination; inputs i_combinations: list, index: Int32
# ---------- visualize: Python ----------
import Rhino.Geometry as rh

o_combination = i_combinations[index]
# ---------- end visualize ----------
panel_4 = Panel([num_bed, num_lounge, num_desk])
num_illuminance_proxy = Number(dist)

# ==== cluster Counts
L = ClusterInput()
L_2 = ClusterInput()
L_3 = ClusterInput()
lng = ListLength(List=L)
lng_2 = ListLength(List=L_2)
lng_3 = ListLength(List=L_3)
multiplication = Multiplication(A=lng, B=lng_2, C=lng_3)
R = ClusterOutput(multiplication)
